# Grasshopper definition demo-tri-auxetic.gh (Grasshopper 1.0.7)

# ----
# Select another model in
# the drop down list to
# re-run the code.
list = ValueList({"tigridia", "lilium_tower", "double_dome", "quarter_dome", "squidward"}, selected="double_dome")

python = GhPythonScript(model=list)  # -> DBPath, m3, m2, pPath
# ---------- python: Python ----------
import platform
fFile = ghdoc.Path

if platform.system() == "Windows":
    fPath = fFile.rsplit('\\',1)
else:    
    fPath = fFile.rsplit('/',1)
    

pPath = fPath[0]

modelPath = fPath[0]+'/input'

DBPath = fPath[0]+'/bass_unit_cell_results.csv'

m3 = modelPath+'/'+model+'/'+model+'.obj'
m2 = modelPath+'/'+model+'/'+model+'_flat.obj'
# ---------- end python ----------

s = Slider(0.25, range=0..1)
c = Slider(0.25, range=0..1)

scale_factor_calculation = PythonScript(fileName=python.m2)  # -> uv_mesh, t_mesh, uv
# ---------- scale_factor_calculation: Python ----------
import Rhino.Geometry as rg
import re
from math import sqrt, pi, tan,cos,sin,degrees, atan2, atan,log
import rhinoscriptsyntax as rs
from collections import Counter

import os
import csv

import ghpythonlib.treehelpers as th
import copy

REX_VT = re.compile(r"vt\s+(-?\d+\.\d+)\s+(-?\d+\.\d+)")
REX_FACE = re.compile(r"f\s+(\d+)\/(\d+)\s+.*?(\d+)\/(\d+)\s+.*?(\d+)\/(\d+).*?")

def vecCross(a, b):
    if len(a)==3:
        c = [a[1]*b[2] - a[2]*b[1],
             a[2]*b[0] - a[0]*b[2],
             a[0]*b[1] - a[1]*b[0]]
    elif len(a)==2:
        c = [0, 0, a[0]*b[1] - a[1]*b[0]]
    return c

def norm(a):
    return sqrt(sum([a[i]**2 for i in [0,1,2]]))
     
def vecSub(a,b): # a - b
    if len(a)==3:
        return [a[i]-b[i] for i in [0,1,2]]
    elif len(a)==2:
        return [a[i]-b[i] for i in [0,1]]
            
def triangle_areas(v, f):
    areas = []
    for i,j,k in f:
        area2 = norm(vecCross(vecSub(v[i], v[j]), vecSub(v[i], v[k])))
        areas.append(area2/2.)
    return areas

def removeId(f_grid, idE):
    '''
    Remove the floppy triangles by replacing them with [-1] so that the numbering doesn't change
    '''
    temp = []
    id_y = []
    id_n = []
    for i,fi in enumerate(f_grid):
        if fi != [-1]: # if it is not already filtered out
            if fi[0] not in idE and fi[1] not in idE and fi[2] not in idE: #check if any of each face has a floppy vertex
                temp.append(fi)
                id_y.append(i)
            else: # if there is one, then change the face to [-1]
                temp.append([-1])
                id_n.append(i)
        else:
            temp.append([-1])
    return id_y,id_n, temp

def normList(l):
    return [li/sum(l) for li in l]
    
def distClosest(needle, hay, d):
    '''
    return all the indices in the list that is close to a value by distance d (1-D)
    '''
    bL = [abs(x-needle)<d for x in hay]
    return [i for i, x in enumerate(bL) if x]
    
def ppClosest(h, n):
    '''
    Find the point in h that n is closest to
    '''
    tempD = [rs.Distance(hi,n) for hi in h]
    if min(tempD)>1:
        errorTog = True
    else:
        errorTog = False
    return tempD.index(min(tempD)), errorTog

def argmax(l):
    return l.index(max(l))
    
def argmin(l):
    return l.index(min(l))
    
def load_obj(obj_path):
    file = open(obj_path)
    lines = file.readlines()

    f = []
    v = []
    uv = []
    
    t_mesh  = rg.Mesh()  # Target mesh
    uv_mesh = rg.Mesh()  # UV (flat) mesh
    
    f_lines  = [line for line in lines if line.startswith("f")]
    v_lines  = [line for line in lines if (line.startswith("v") and line.find("n")==-1 and line.find("t")==-1)]
    uv_lines = [line for line in lines if line.startswith("vt")]
    
    for line in v_lines:
        v.append([float((line.split(' '))[1]),float((line.split(' '))[2]),float((line.split(' '))[3])])
        t_mesh.Vertices.Add(rg.Point3d(*v[-1]))
    
    uvs = [[float(coord) for coord in REX_VT.findall(line)[0]] for line in uv_lines]
    uv_indices = [None] * len(uvs)
    
    for line in f_lines:
        f.append([int(line.split(' ')[1].split('/')[0])-1,int(line.split(' ')[2].split('/')[0])-1,int(line.split(' ')[3].split('/')[0])-1])
        
        mf = rg.MeshFace(*f[-1])
        
        uv_mesh.Faces.AddFace(mf) # the two meshes have the same connectivities
        t_mesh.Faces.AddFace(mf)  # the two meshes have the same connectivities
        
        res_str = REX_FACE.findall(line)[0]
        res_int = [int(index) - 1 for index in res_str]

        v1, uv1, v2, uv2, v3, uv3 = res_int
        
        try:
            uv_indices[v1] = uv1
            uv_indices[v2] = uv2
            uv_indices[v3] = uv3
        except Exception as e:
            print("uv1", uv1, "uv2", uv2, "uv3", uv3)
            print(len(uvs))
            raise e
            
#    print(uv_indices)
    uvs_sorted = []
    for i in uv_indices:
        if i!=None:
            uvs_sorted.append(uvs[i])
        
 #   uvs_sorted = [uvs[i] for i in uv_indices]
    
    [uv_mesh.Vertices.Add(rg.Point3d(uvs[0],uvs[1],0)) for uvs in uvs_sorted]
    uv_mesh.Compact()
    t_mesh.Normals.ComputeNormals()
    t_mesh.Compact()
    
    return [v,f,uvs_sorted,uv_mesh,t_mesh]

[v,f,uv,uv_mesh,t_mesh]=load_obj(fileName)

uv = [rs.AddPoint(uvi) for uvi in uv]
# ---------- end scale_factor_calculation ----------

# ----
# edge length of unit cell
number_slider = Slider(10, range=0..100)

m3d = Mesh(scale_factor_calculation.t_mesh)
num = Number(number_slider)
m2d = Mesh(scale_factor_calculation.uv_mesh)
uv = Data(scale_factor_calculation.uv)
scale_factors = PythonScript(t_mesh=m3d, uv_mesh=m2d, uvs=uv, geomType="tri", in_L=num)  # -> mesh_scale_area, scale_area, G, uv_c; inputs uv_mesh: Mesh, uvs: list of Point3d
# ---------- scale_factors: Python ----------
import Rhino.Geometry as rg
import re
from math import sqrt, pi, tan,cos,sin,degrees, atan2, atan, asin, acos
import rhinoscriptsyntax as rs
from collections import Counter

import os
import csv

import ghpythonlib.treehelpers as th
import copy

REX_VT = re.compile(r"vt\s+(-?\d+\.\d+)\s+(-?\d+\.\d+)")
REX_FACE = re.compile(r"f\s+(\d+)\/(\d+)\s+.*?(\d+)\/(\d+)\s+.*?(\d+)\/(\d+).*?")

def avgPt(p):
    """
    Find the centroid of a given list of points
    """
    x=[ sum([p_i[i] for p_i in p])/len(p) for i in [0,1,2]]
    
    return x
    
def vecCross(a, b):
    """
    Find the cross product of two vectors, 2D or 3D
    """
    if len(a)==3:
        c = [a[1]*b[2] - a[2]*b[1],
             a[2]*b[0] - a[0]*b[2],
             a[0]*b[1] - a[1]*b[0]]
    elif len(a)==2:
        c = [0, 0, a[0]*b[1] - a[1]*b[0]]
    return c

def norm(a,p):
    """
    Find the norm of a vector
    """
    return sqrt(sum([ai**p for ai in a])) 
    
def vecSub(a,b): 
    """
    Subtract vector a from vector b, or b-a
    """
    if len(a)==3:
        return [b[i]-a[i] for i in [0,1,2]]
    elif len(a)==2:
        return [b[i]-a[i] for i in [0,1]]
            
def triangle_areas(v, f):
    """
    Find area of triangles given a list of vertices and faces
    """
    areas = []
    for i,j,k,l in f:
        area2 = norm(vecCross(vecSub(v[j], v[i]), vecSub(v[k], v[i])),2)
        areas.append(area2/2.)
    return areas

def get_floppy_polygons(f_grid):
    """
    filter the polygon that has at least one vertex that is not connected to any other triangles
    """
    
    f_grid_flat = [item for sublist in f_grid for item in sublist]
   
    res= Counter (f_grid_flat)
    
    idE = []
    
    for key, item in res.items():  # for key, item in dictionary.iteritems():  (for Python 2.x)
        if item <= 1:
            idE.append(key)
            
    return idE

def listOccur(x,y):
    c = 0
    for xi in x:
        if xi in y:
            c+=1
    return c
    
def removeId(f_grid, idE, maxC):
    """
    Remove the floppy polygons by replacing them with [-1] so that the numbering doesn't change
    """
    temp = []
    id_y = []
    id_n = []
    
    for i,fi in enumerate(f_grid):
        if fi != [-1]: # if it is not already filtered out
            #if any(item in fi for item in idE) == False: #check if any of each face has a floppy vertex
            if listOccur(fi, idE)<=maxC:
                temp.append(fi)
                id_y.append(i)
            else: # if there is one, then change the face to [-1]
                temp.append([-1])
                id_n.append(i)
        else:
            temp.append([-1])
    return id_y,id_n, temp

def norm(a,p):
    """
    Find the norm of a vector
    """
    return (sum([ai**p for ai in a]))**(1/p)
    
def normList(l,p):
    """
    Normalize a list
    """
    if p=='inf': # inf norm
        return [li/max(l) for li in l]
    else:
        return [li/norm(l,p) for li in l]
    
def distClosest(needle, hay, d):
    """
    return all the indices in the list that is close to a value by distance d (1-D)
    """
    bL = [abs(x-needle)<d for x in hay]
    return [i for i, x in enumerate(bL) if x]
    
def ppClosest(h, n):
    """
    Find the point in h that n is closest to
    """
    tempD = [rs.Distance(hi,n) for hi in h]
    if min(tempD)>1:
        errorTog = True
    else:
        errorTog = False
    return tempD.index(min(tempD)), errorTog

def noneList(x,a):
    """ change the indices a of x to [-1] """
    for ai in a:
        x[ai] = [-1]
        
def noneListR(a):
    """ remove [-1] """
    idxD = dict()
    idx = 0
    temp = []
    for i, ai in enumerate(a):
        if ai != [-1]:
            temp.append(ai)
            idxD[i]=idx
            idx+=1
            
    return temp, idxD
    
def argmax(l):
    """ Get ID of max element in list """
    return l.index(max(l))
        
def argmin(l):
    """ Get ID of min element in list """
    return l.index(min(l))
    
def remove_unused_verts(v, f):
    """
    Takes a mesh in form of verts and triangles and
    returns a new mesh with the verts removed that are not
    referenced in the polygons.
    """
    
    v_new = []
    f_new = []
    
    for fi in f:
        # Round is cheap method to check do "is approximately in"
        vTemp = [[round(x,8) for x in v[fii]] for fii in fi]
        
        # if v1,2,3 is not in v_new then it is a new point that should be appended
        for vi in vTemp:
            if vi not in v_new:
                v_new.append(vi)
        
        # faces then append the id of all three points, 
        # now that they have to be in v_new
        
        f_new.append([v_new.index(vi) for vi in vTemp])
        
    return v_new, f_new

def load_mesh_and_scale_facs(t_mesh,uvs,verbose):
    
    # Get face and vertices of the target mesh
    f = rs.MeshFaceVertices(t_mesh)
    v = rs.MeshVertices(t_mesh)
    
    # calculate the area per triangular mesh element in 3D and in conformal map
    tri_areas3d = triangle_areas(v, f)
    tri_areas2d = triangle_areas(uvs, f)

    # calculate the scale factor per triangle by dividing 
    mesh_scale_area = [x/y for x,y in zip(tri_areas3d, tri_areas2d)]

    zero_area_2dtris = [tri_areas2d < 1e-8 for x in tri_areas2d]

    for i,x in enumerate(zero_area_2dtris):
        if x == True:
            mesh_scale_area[i] = None

    if sum(zero_area_2dtris) > 0:
        warnings.warn(
            "Something is wrong with your UV-map. Some triangles have near-zero or zero area."
            "This leads to infinite scale factors."
        )

    if verbose:
        print("Scale facs min: "+str(min(mesh_scale_area)) +", max: "+str(max(mesh_scale_area)))

    return v, f,mesh_scale_area

def flip(i):
    if i==0:
        return 1
    elif i==1:
        return 0
        
        
def generateSqrGrid(rows, cols, l=1, ox=0, oy=0):
    
    v_grid = [] # vertex list of x,y,z coord
    f_grid = [] # per faces has lists of vertice ids
    c_grid = [] # centroid coordinate per element
    i_grid = [] # due to the mirroring nature of the aux and bass unit cels, we record whether 1) tri, up or down, 2) quad, top left, bottom left, top right, bottom right
    x_grid = [] # per face, the id of all the neighbouring faces
    
    h = l # Height of the square normalized to 1
    
    # generate all the vertices for the squares
    idE = 0 # Counter for elements
    for row in range(rows):
        for col in range(cols):
            v_grid.append([l*col+ox,h*row+oy, 0])
    
    # generate all the connectivities (node numbers)
    # and the quadrant per square
    for row in range(rows-1):
        for col in range(cols-1):
            
            n = [col + row*cols,
                 col + row*cols + 1,
                 col + (row+1)*cols + 1,
                 col + (row+1)*cols]
            
            if row%2 == 0:
                if col%2 == 0:
                    fL = [n[0], n[1], n[2], n[3]]
                    i_grid.append([ 1, 1, -1,  -1])
                else:
                    fL = [n[1], n[0], n[3], n[2]]
                    i_grid.append([-1, 1,  1,  -1])
            else:
                if col%2 == 0:
                    fL = [n[3], n[2], n[1], n[0]]
                    i_grid.append([ 1, -1, -1,  1])
                else:
                    fL = [n[2], n[3], n[0], n[1]]
                    i_grid.append([-1, -1,  1,  1])
            
            # cL is the centroid per square
            cL = avgPt([v_grid[fLi] for fLi in fL])
            
            f_grid.append(fL)
            c_grid.append(cL)
                
            # Find the ID of the neighbouring elements (special cases are the edges, and corners)
            if row == 0:
                if col == 0:
                    x_grid.append([                          idE + 1, idE + cols - 1])
                elif col == cols-2:
                    x_grid.append([idE - 1,                           idE + cols - 1])
                else:
                    x_grid.append([idE - 1,                  idE + 1, idE + cols - 1])
            elif row == rows-2:
                if col == 0:
                    x_grid.append([          idE - cols + 1, idE + 1                ])
                elif col == cols-2:
                    x_grid.append([ idE - 1, idE - cols + 1                         ])
                else:
                    x_grid.append([ idE - 1, idE - cols + 1, idE + 1                ])
            else:
                if col == 0:
                    x_grid.append([          idE - cols + 1, idE + 1, idE + cols - 1])
                elif col == cols-2:
                    x_grid.append([ idE - 1, idE - cols + 1,          idE + cols - 1])
                else:
                    x_grid.append([ idE - 1, idE - cols + 1, idE + 1, idE + cols - 1])

            idE+=1   

    return v_grid, f_grid, c_grid, i_grid, x_grid

def generateTriGrid(rows, cols, l=1, ox=0, oy=0):
    
    v_grid = [] # vertex list of x,y,z coord
    f_grid = [] # per faces has lists of vertice ids
    c_grid = [] # centroid coordinate per element
    i_grid = [] # due to the mirroring nature of the aux and bass unit cels, we record whether 1) tri, up or down, 2) quad, top left, bottom left, top right, bottom right
    x_grid = [] # per face, the id of all the neighbouring faces
    
    h = sqrt(3)/2*l # Height of the triangle
    
    idE = 0 # Counter for elements
    for row in range(rows):
        for col in range(cols):
            if row%2==0:
                v_grid.append([l*col+ox,h*row+oy, 0])
            else:
                v_grid.append([l*col+l/2+ox,h*row+oy, 0])
                
    for row in range(rows-1):
        iList = []
        for col in range(cols-1):
            
            if row%2==0:
                m = 1
                n = 0
                iList.append(0)
                iList.append(1)
                
            else:
                m = 0
                n = 1
                iList.append(1)
                iList.append(0)
        
            n0 = col + row*cols
            n1 = col + row*cols + 1
            n2 = col + (row+1)*cols + n
            
            # iso triangle #1
            fL1 = [n0,n1,n2]
        
            c0 = (v_grid[n0][0]+v_grid[n1][0])/2
            c1 = v_grid[n0][1] + sqrt(3)/6*l
            
            # center of tri #1
            cL1 = [c0,c1,0]
            
            n0 = col + row*cols + m
            n1 = col + (row+1)*cols + 1
            n2 = col + (row+1)*cols
            
            # iso triangle #2
            fL2 = [n0,n1,n2]
            
            c0 = (v_grid[n1][0]+v_grid[n2][0])/2
            c1 = v_grid[n1][1] - sqrt(3)/6*l
            
            # center of tri #2
            cL2 = [c0,c1,0]

            # this generation always starts with an a triangle with bottom edge aligned with the xaxis first
            if row%2==0:
                    
                f_grid.append(fL1)
                c_grid.append(cL1)
                f_grid.append(fL2)
                c_grid.append(cL2)
                
                # Find the ID of the neighbouring elements
                if row == 0:
                    if col == 0:
                        x_grid.append([idE+1])
                    else:
                        x_grid.append([idE-1, idE+1])
                else:
                    if col ==0:
                        x_grid.append([idE+1, idE-(cols-1)*2])
                    else:
                        x_grid.append([idE-1, idE-(cols-1)*2, idE+1])
                     
                idE+=1   
                
                # Find the ID of the neighbouring elements
                if row == rows-2:
                    if col == cols-2:
                        x_grid.append([idE-1])
                    else:
                        x_grid.append([idE-1, idE+1])
                else:
                    if col == cols-2:
                        x_grid.append([idE-1, idE+(cols-1)*2])
                    else:
                        x_grid.append([idE-1, idE+(cols-1)*2, idE+1])
                        
                idE+=1
                
            else:
                f_grid.append(fL2)
                c_grid.append(cL2)
                
                f_grid.append(fL1)
                c_grid.append(cL1)
                
                # Find the ID of the neighbouring elements
                if row == rows - 2:
                    if col ==0:
                        x_grid.append([idE+1])
                    else:
                        x_grid.append([idE-1, idE+1])

                else:
                    if col ==0:
                        x_grid.append([idE+1, idE+(cols-1)*2])
                    else:
                        x_grid.append([idE-1, idE+(cols-1)*2, idE+1])
                    
                idE+=1
                
                # Find the ID of the neighbouring elements
                if row == 0:
                    # But this wont happen unless we flip the order or even and odd
                    if col == cols - 2:
                        x_grid.append([idE-1])
                    else:
                        x_grid.append([idE-1, idE+1])
                else:
                    if col == cols-2:
                        x_grid.append([idE-1, idE-(cols-1)*2])
                    else:
                        x_grid.append([idE-1, idE-(cols-1)*2, idE+1])
                        
                idE+=1
                
        # in even last one, i dont exclude the upper triangle, which causes issues
        i_grid.append(iList)
        
    i_grid = [item for sublist in i_grid for item in sublist]
    
    return v_grid,f_grid,c_grid,i_grid, x_grid

def generateGrid(rsv2d, params):
    """
    Takes a flattened mesh and returns the verts, faces
    for a polygon (tri or quad) grid that envelops the input mesh.
    """
    boundv2d = rs.PointArrayBoundingBox(rsv2d)

    if params['geomType'] == 'sqr':
        factor = 1
    elif params['geomType'] == 'tri':
        factor = sqrt(3)/2
        
    v2d_dim = [boundv2d[2][0] - boundv2d[0][0], boundv2d[2][1] - boundv2d[0][1]] # center of the flattened mesh

    v2d_c = [v2d_dim[0]/2 + boundv2d[0][0], v2d_dim[1]/2 + boundv2d[0][1]] # center of the flattened mesh
    
    # number of cols and rows (5 is added just so I can cover the whole thing without question)
    cols = int(v2d_dim[0]/params['edgeLen']+5)
    rows = int(v2d_dim[1]/(factor*params['edgeLen'])+5)
    
    if rows + cols < 5:
        warnings.warn("The design is very small. Check your model size and units (mm assumed).")

    gc = [cols*params['edgeLen'], rows*factor*params['edgeLen']] # size of the grid
    gd = [v2d_c[0] - gc[0]/2, v2d_c[1] - gc[1]/2] # vector from the center of the flattened mesh to the center of the grid
    
    if params['geomType'] == 'sqr':
        v_grid, f_grid, c_grid, i_grid, x_grid = generateSqrGrid(rows, cols, params['edgeLen'], gd[0], gd[1])
    elif params['geomType'] == 'tri':
        v_grid, f_grid, c_grid, i_grid, x_grid = generateTriGrid(rows, cols, params['edgeLen'], gd[0], gd[1])
    
    return v_grid, f_grid, c_grid, i_grid, x_grid

    
def fitGrid(v_grid, f_grid, c_grid, i_grid, x_grid, uv_mesh, geomType, scale_facs, edgeLen, verbose=True):
    """
    Takes a regular triangular grid and a flattened triangular mesh
    and interpolates the scale factors from the mesh to the regular grid.
    """

    # centroids flat is the coordinates of the center of the flattened triangles
    # scale_facs is calculated per uv triangle [num mesh elem x 1]
    uv_c = rs.MeshFaceCenters(uv_mesh)

    # if not using the bounding box, it will use the uv map instead.
    # the FieldSampler checks for holes or concave parts of the uv map
    # if the polygons are inside the mesh then True, otherwise false.
    
    inside_uv_tris = [uv_mesh.ClosestMeshPoint(rs.coerce3dpoint(rs.AddPoint(x)),0.0000000001) for x in c_grid]
    
    inside_tris = [i for i,tri in enumerate(inside_uv_tris) if tri is None]
    
    # replace all the polygon not inside by -1
    noneList(f_grid,inside_tris)
    noneList(c_grid,inside_tris)
    noneList(i_grid,inside_tris)
    noneList(x_grid,inside_tris)

    # get polygons with at least one vertex that's not shared by any other polygons
    idE = get_floppy_polygons(f_grid)
    
    if geomType == 'sqr':
        maxC = 1 # squares can't have two single one-two edge vertex
    elif geomType == 'tri':
        maxC = 0 # triangles can't have a single one-two edge vertex
        
    # remove those polygons from the connectivity by -1
    idx, idxn, f_grid = removeId(f_grid, idE, maxC)
    
    # replace all the floppy polygons by -1
    noneList(c_grid, idxn)
    noneList(i_grid, idxn)
    noneList(x_grid, idxn)
    
    # Actually remove all the -1, and keep the coressponding indices
    c_grid,_    = noneListR(c_grid)
    i_grid,_    = noneListR(i_grid)
    x_grid,_    = noneListR(x_grid)
    f_grid,idxD = noneListR(f_grid)
    
    # do the same for x_grid, since it is a neighbouring tri relationship
    temp = []
    for xi in x_grid:
        tempL = [idxD[xii] for xii in xi if xii in idxD]
        temp.append(tempL)
    x_grid = temp
    
    # now calculate the scale factor by weighted averaging the scale factors of the neighbouring mesh elements in the uv mesh
    scale_area = []
    
    #for ci in c_grid:
    #    index = rs.PointCloudKNeighbors(uv_c, ci, 5)
    #    d = normList([1./rs.Distance(ci, uv_c[i]) for i in index[0]])
    #    scale_area.append(sum([scale_facs[idi]*di for idi,di in zip(index[0],d)]))
          
    # sampling based on equi 
    for ci in c_grid:
        beta = 0.5
        index = rs.PointCloudClosestPoints(uv_c,ci,beta*edgeLen)
        d = normList([-1/(beta*edgeLen)*rs.Distance(ci, uv_c[i])+1 for i in index[0]],1)
        scale_area.append(sum([scale_facs[idi]*di for idi,di in zip(index[0],d)]))
   
    # get length from area change by sqrting

    v_out     = v_grid # coordinates
    f_out     = f_grid # connectivity
    c_out     = c_grid # centroid of each triangle
    i_out     = i_grid # indicate whether the triangle is up or down
    x_out     = x_grid # list of all the neighbouring triangles
    
    v_out, f_out = remove_unused_verts(v_out, f_out)
    
    return v_out, f_out, c_out, i_out, x_out, scale_area, uv_c
   
params = {
    "edgeLen":       in_L,
    "geomType":      geomType
}

# The UV map (called 2D) is scaled here prior to calculating the necessary global scaling
v, f, mesh_scale_area = load_mesh_and_scale_facs(t_mesh,uvs, False)

rs_v  = rs.AddPoints(v)
rs_uv = rs.AddPoints(uvs)

# Generate a regular triangular grid that is centered around the flattened uv mesh
v_grid, f_grid, c_grid, i_grid, x_grid = generateGrid(rs_uv, params)

[v_out, f_out, c_out, i_out, x_out, scale_area,uv_c] = fitGrid(v_grid, f_grid, c_grid, i_grid, x_grid, uv_mesh = uv_mesh, geomType = params['geomType'], scale_facs = mesh_scale_area, edgeLen= params['edgeLen'])

mesh_scale_area = [i/min(mesh_scale_area) for i in mesh_scale_area]

scale_area = [i/min(scale_area) for i in scale_area]
G = [v_out, f_out, c_out, i_out, x_out]
uv_c = rs.AddPoints(uv_c)
G = th.list_to_tree(G)
# ---------- end scale_factors ----------
demesh = DeconstructMesh(Mesh=m3d)  # -> Vertices, Faces, Colours, Normals
l = Slider(0.6, range=0..1)

# ----
# Visualization of mesh and grid
# Visualizing 3D mesh scale factor
visualization = GhPythonScript(m2d=m3d, scale_length=scale_factors.mesh_scale_area)  # -> m2dP, c; inputs scale_length: list; disabled
# ---------- visualization: Python ----------
import Rhino.Geometry as rg
import re
from math import sqrt, pi, tan,cos,sin,degrees, atan, atan2
import rhinoscriptsyntax as rs
from collections import Counter

import os
import csv

import ghpythonlib.treehelpers as th
import copy

import rhinoscriptsyntax as rs


_plasma_data = [[0.050383, 0.029803, 0.527975],
                [0.063536, 0.028426, 0.533124],
                [0.075353, 0.027206, 0.538007],
                [0.086222, 0.026125, 0.542658],
                [0.096379, 0.025165, 0.547103],
                [0.105980, 0.024309, 0.551368],
                [0.115124, 0.023556, 0.555468],
                [0.123903, 0.022878, 0.559423],
                [0.132381, 0.022258, 0.563250],
                [0.140603, 0.021687, 0.566959],
                [0.148607, 0.021154, 0.570562],
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cmap_viridis= [[253,231,37],
[248,230,33],
[241,229,29],
[236,229,27],
[229,228,25],
[223,227,24],
[216,226,25],
[210,226,27],
[202,225,31],
[194,223,35],
[189,223,38],
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
m2dV = rs.MeshVertices(m2d)
m2dF = rs.MeshFaceVertices(m2d)

m2dP = [rs.AddPolyline([m2dV[fii] for fii in fi]+[m2dV[fi[0]]]) for fi in m2dF]
_plasma_data = [[x[0]*255,x[1]*255,x[2]*255] for x in _plasma_data]

def normScale(scale_length):
    b = 1. - (4.-1.)/(max(scale_length)-1)
    temp = [(4.-1.)/(max(scale_length)-1)*x + b for x in scale_length]
    return [1/3*x-1/3 for x in temp]

scale_length = normScale(scale_length)
pMap = cmap_viridis
cmap = []
for scale in scale_length:
    cmap.append(pMap[int(round((scale)*(len(pMap)-1)))])

c = [rs.CreateColor(ci) for ci in cmap]
# ---------- end visualization ----------
material = CreateMaterial(Diffuse=visualization.c, Specular=RGB(255, 255, 255), Emission=RGB(0, 0, 0), Transparency=0, Shine=0)  # disabled
crv = Curve(visualization.m2dP)  # disabled
srf = Surface(visualization.m2dP)  # disabled
preview = CustomPreview(Geometry=srf, Material=material)  # disabled

# ----
# Visualizing 2D mesh scale factor
visualization_2 = GhPythonScript(m2d=m2d, scale_length=scale_factors.mesh_scale_area)  # -> m2dP, c; inputs scale_length: list; disabled; same code as visualization
material_2 = CreateMaterial(Diffuse=visualization_2.c, Specular=RGB(255, 255, 255), Emission=RGB(0, 0, 0), Transparency=0, Shine=0)  # disabled
crv_2 = Curve(visualization_2.m2dP)  # disabled
srf_2 = Surface(visualization_2.m2dP)  # disabled
preview_2 = CustomPreview(Geometry=srf_2, Material=material_2)  # disabled

# ----
# Visualizing grid scale factor
visualization_3 = GhPythonScript(G=scale_factors.G, scale_length=scale_factors.scale_area)  # -> g_out, c; inputs G: tree, scale_length: list; disabled
# ---------- visualization_3: Python ----------
import Rhino.Geometry as rg
import re
from math import sqrt, pi, tan,cos,sin,degrees, atan, atan2
import rhinoscriptsyntax as rs
from collections import Counter

import os
import csv

import ghpythonlib.treehelpers as th
import copy

import rhinoscriptsyntax as rs


_plasma_data = [[0.050383, 0.029803, 0.527975],
                [0.063536, 0.028426, 0.533124],
                [0.075353, 0.027206, 0.538007],
                [0.086222, 0.026125, 0.542658],
                [0.096379, 0.025165, 0.547103],
                [0.105980, 0.024309, 0.551368],
                [0.115124, 0.023556, 0.555468],
                [0.123903, 0.022878, 0.559423],
                [0.132381, 0.022258, 0.563250],
                [0.140603, 0.021687, 0.566959],
                [0.148607, 0.021154, 0.570562],
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cmap_viridis= [[253,231,37],
[248,230,33],
[241,229,29],
[236,229,27],
[229,228,25],
[223,227,24],
[216,226,25],
[210,226,27],
[202,225,31],
[194,223,35],
[189,223,38],
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
_plasma_data = [[x[0]*255,x[1]*255,x[2]*255] for x in _plasma_data]
[v_out, f_out, c_out, i_out, x_out] = th.tree_to_list(G)

g_out = []
for fi in f_out:
    g_out.append(rs.AddSrfPt([rs.AddPoint(v_out[fii]) for fii in fi]))

def normScale(scale_length):
    b = 1. - (4.-1.)/(max(scale_length)-1)
    temp = [(4.-1.)/(max(scale_length)-1)*x + b for x in scale_length]
    return [1/3*x-1/3 for x in temp]

scale_length = normScale(scale_length)
pMap = cmap_viridis
cmap = []
for scale in scale_length:
    cmap.append(pMap[int(round((scale)*(len(pMap)-1)))])

c = [rs.CreateColor(ci) for ci in cmap]
# ---------- end visualization_3 ----------
material_3 = CreateMaterial(Diffuse=visualization_3.c, Specular=RGB(255, 255, 255), Emission=RGB(0, 0, 0), Transparency=0, Shine=0)  # disabled
crv_3 = Curve(visualization_3.g_out)  # disabled
preview_3 = CustomPreview(Geometry=visualization_3.g_out, Material=material_3)  # disabled

# ----
# mapping of 2D and 3D mesh
ln = Line(StartPoint=uv, EndPoint=demesh.Vertices)  # disabled
number_slider_2 = Slider(1, range=0..1)  # disabled
eval = EvaluateLength(Curve=ln, Length=number_slider_2, Normalized=True)  # -> Point, Tangent, Parameter; disabled
conmesh = ConstructMesh(Vertices=eval.Point, Faces=demesh.Faces)  # disabled
mesh = Mesh(conmesh)  # disabled

list_2 = ValueList({"min", "mid", "max"}, selected="max")
data = Data("aux")
num_2 = Number(l)
aux_tri = PythonScript(scale_area=scale_factors.scale_area, geomType="tri", funcType=data, inSqrVar=num_2, scaleShift=list_2)  # -> out, msg, scale_length, UC_param; inputs scale_area: list
# ---------- aux_tri: Python ----------
import Rhino.Geometry as rg
import re
from math import sqrt, pi, tan,cos,sin,degrees, atan2, atan, asin, acos
import rhinoscriptsyntax as rs
from collections import Counter

import os
import csv

import ghpythonlib.treehelpers as th
import copy

REX_VT = re.compile(r"vt\s+(-?\d+\.\d+)\s+(-?\d+\.\d+)")
REX_FACE = re.compile(r"f\s+(\d+)\/(\d+)\s+.*?(\d+)\/(\d+)\s+.*?(\d+)\/(\d+).*?")

def avgPt(p):
    """
    Find the centroid of a given list of points
    """
    x = [0,0,0]
    
    for i in [0,1,2]:
        x[i]=sum([p_i[i] for p_i in p])/len(p)
    
    return x
    
def vecCross(a, b):
    """
    Find the cross product of two vectors, 2D or 3D
    """
    if len(a)==3:
        c = [a[1]*b[2] - a[2]*b[1],
             a[2]*b[0] - a[0]*b[2],
             a[0]*b[1] - a[1]*b[0]]
    elif len(a)==2:
        c = [0, 0, a[0]*b[1] - a[1]*b[0]]
    return c

def norm(a):
    """
    Find the norm of a vector
    """
    return sqrt(sum([a[i]**2 for i in [0,1,2]]))
     
def vecSub(a,b): 
    """
    Subtract vector a from vector b, or b-a
    """
    if len(a)==3:
        return [b[i]-a[i] for i in [0,1,2]]
    elif len(a)==2:
        return [b[i]-a[i] for i in [0,1]]

def listOccur(x,y):
    c = 0
    for xi in x:
        if xi in y:
            c+=1
    return c
    
def normList(l):
    """
    Normalize a list
    """
    return [li/sum(l) for li in l]

def argmax(l):
    ''' Get ID of max element in list '''
    return l.index(max(l))
    
def argmin(l):
    ''' Get ID of min element in list '''
    return l.index(min(l))
    

def distClosest(needle, hay, d):
    """
    return all the indices in the list that is close to a value by distance d (1-D)
    """
    bL = [abs(x-needle)<d for x in hay]
    return [i for i, x in enumerate(bL) if x]
    
def flip(i):
    if i==0:
        return 1
    elif i==1:
        return 0

def scaleLimits(geomType, funcType, inSqrVar=0):
    """ 
    Get min and max length scale factor of each shape 
    """
    
    if geomType == 'tri':
        if funcType == 'aux': 
            phi_min = pi/3.
            phi_max = 0.0
            xf_max = 2.# edge length change is 1 to (2)
    elif geomType == 'sqr':
        if funcType == 'aux': 
            phi_min = pi/4.
            phi_max = 0.001
            xf_max = sqrt(2.)# edge length change is 1 to sqrt(2)
        elif funcType == 'bist_0_a': 
            a = inSqrVar
            phi_min = pi/8.
            phi_max = 0.001
            xf_max = -1+2*cos(phi_min)**2+(-4*a+2)*cos(phi_min)*sin(phi_min)  # edge length change is 1 to maximum as dictated by input
        elif funcType == 'bist_0_l': 
            l = inSqrVar
            phi_min = pi/2.
            phi_max = 0.001
            xf_max = 2*sin(phi_min)*l+1
        elif funcType == 'bist_1_a': 
            a = inSqrVar
            phi_min = pi/2.
            phi_max = 0.001
            xf_max = ((-4*a+3)*sin(phi_min)+cos(phi_min))/(sin(phi_min)+cos(phi_min))
        elif funcType == 'bist_1_l': 
            l = inSqrVar
            phi_min = pi/4.
            phi_max = 0.0001
            xf_max = 2.*l*sin(phi_min)+1.
            
    return {'phi_min':phi_min, 'phi_max':phi_max, 'xf_min':1., 'xf_max':xf_max} 
    
def auxPhi (xf, geomType, funcType, scaleRange):
    if geomType =='tri':
        if funcType == 'aux': # validated, the bistable version is from BASS and uses the other component
            if xf >= scaleRange['xf_max']:
                phi = scaleRange['phi_max']
            elif xf <= scaleRange['xf_min']:
                phi = scaleRange['phi_min']
            else:
                phi = atan2(sqrt(2+xf**2-2*sqrt(3*xf**2-3))/(2*xf), -sqrt(2+xf**2-2*sqrt(3*xf**2-3))*(3*xf**2+4*sqrt(3*xf**2-3))*sqrt(3)/(6*xf**3-24*xf))
    elif geomType == 'sqr':           
        if funcType == 'aux': # validated
            if xf >= scaleRange['xf_max']:
                phi = scaleRange['phi_max']
            elif xf <= scaleRange['xf_min']:
                phi = scaleRange['phi_min']
            else:
                phi = atan2(-(xf**2-2*sqrt(xf**2-1))*sqrt(2*xf**2+4*sqrt(xf**2-1))/(xf*(xf**2-2)), sqrt(2*xf**2+4*sqrt(xf**2-1))/xf)
        elif funcType =='bist_0_a':  # validated
            a = inSqrVar# a must be provided
            if xf >= scaleRange['xf_max']:
                phi = scaleRange['phi_max']
            elif xf <= scaleRange['xf_min']:
                phi = scaleRange['phi_min']
            else:
                phi = atan2(sqrt(-(-4*a**2 + sqrt((2*a - 1)**2*(4*a**2 - xf**2 - 4*a + 2)) + 4*a + xf - 2)/(2*a**2 - 2*a + 1)), (-4*a**2*xf + 4*a*xf + sqrt((2*a - 1)**2*(4*a**2 - xf**2 - 4*a + 2)) - xf)/(sqrt((4*a**2 - sqrt((2*a - 1)**2*(4*a**2 - xf**2 - 4*a + 2)) - 4*a - xf + 2)/(2*a**2 - 2*a + 1))*(4*a**3 - 6*a**2 + 4*a - 1)))
        elif funcType =='bist_0_l': # validated
            l = inSqrVar # l must be provided
            if xf >= scaleRange['xf_max']:
                phi = scaleRange['phi_max']
            elif xf <= scaleRange['xf_min']:
                phi = scaleRange['phi_min']
            else:
                phi = atan2((xf-1)/l, sqrt(4*l**2-xf**2+2*xf-1)/l)
        elif funcType =='bist_1_a': # validated
            a = inSqrVar# a must be provided
            if xf >= scaleRange['xf_max']:
                phi = scaleRange['phi_max']
            elif xf <= scaleRange['xf_min']:
                phi = scaleRange['phi_min']
            else:
                phi = -atan((xf-1)/(4*a+xf-3))
        elif funcType =='bist_1_l': # validated
            l = inSqrVar # l must be provided
            if xf >= scaleRange['xf_max']:
                phi = scaleRange['phi_max']
            elif xf <= scaleRange['xf_min']:
                phi = scaleRange['phi_min']
            else:
                phi = asin((xf-1)/(2*l))
    return phi
    
def interp_and_rescale(scale_area, params,  verbose=True):
    """
    Takes a regular triangular grid and a flattened triangular mesh
    and interpolates the scale factors from the mesh to the regular grid.

    for_expanded_cells: Shift the scale factors such that we get parameters for opened cells that close
                        instead of closed ones that open 

    use_bb: Use the bounding box of the uv map instead of the uv map itself to fit the tri grid into.
            Useful for cylinders, i.e. if you need the top and bottom of the pattern to be gluable together. Will
            introduce some error however, it's better to adapt the boundary in BFF if possible.
    """

    # centroids flat is the coordinates of the center of the flattened triangles
    # scale_facs is calculated per uv triangle [num mesh elem x 1]

    scaleRange = scaleLimits(geomType, funcType,inSqrVar)
    
    scale_length   = [sqrt(x) for x in scale_area]

    if verbose == True:
        print("Min factor (uv): " + str(min(scale_length)))
        print("Max factor (uv): " + str(max(scale_length)))
    
    if params['scaleShift'] =='max':
        # now shift the scale range such that the the largest scale is the maximum
        # (this is a heuristic, it means that the flat shape will be the smallest)
        uv_scale = scaleRange['xf_max'] / max(scale_length)*0.9999
    elif params['scaleShift'] =='min':
        # now shift the scale range such that the the smallest scale is the minimum 
        # (this is a heuristic, it means that the flat shape will be the largest)
        uv_scale = scaleRange['xf_min'] / min(scale_length)
    elif params['scaleShift'] =='mid':
        # now shift the scale range such that the the smallest scale is the minimum 
        # (this is a heuristic, it means that the flat shape will be the largest)
        uv_scale = (scaleRange['xf_max'] + scaleRange['xf_min']) / (min(scale_length) +  max(scale_length))
    
    scale_length = [x*uv_scale for x in scale_length]
    
    if verbose ==True:
        print("Scaled by " + str(uv_scale) + " to")
        print("Scaled min factor (uv): " + str(min(scale_length)))
        print("Scaled max factor (uv): " + str(max(scale_length)))
        
    errorTog = False
    # this only happens with expanded cells
    if max(scale_length) > scaleRange['xf_max'] * 1.0001:
        print("Design exceeds maximal length scaling")
        errorTog = True
    if min(scale_length) < scaleRange['xf_min'] / 1.0001:
        print("Design exceeds minimum length scaling")
        errorTog = True

    # calculate the phi angle for the given length scale
    UC_param = [auxPhi(i, geomType, funcType, scaleRange) for i in scale_length]

    return UC_param, uv_scale, scale_length, errorTog
   
params = {
    "geomType":      geomType,
    "funcType":      funcType,
    "scaleShift":    scaleShift
}

[UC_param, uv_scale, scale_length, errorTog] = interp_and_rescale(scale_area, params = params)
        
UC_param = th.list_to_tree(UC_param)

if errorTog == True:
    msg = 'Design exceeds length scaling for bistable auxetics, try using auxetics instead.'
else:
    msg = 'No errors'
# ---------- end aux_tri ----------
G = Data(scale_factors.G)
grid_mesh = GhPythonScript(G=G)  # -> G_mesh, G_edge; inputs G: tree
# ---------- grid_mesh: Python ----------
import Rhino.Geometry as rg
import rhinoscriptsyntax as rs

import ghpythonlib.treehelpers as th
[v_out, f_out, c_out, i_out, x_out] = th.tree_to_list(G)

G_mesh  = rg.Mesh()  #
[G_mesh.Vertices.Add(rs.coerce3dpoint(rs.AddPoint(x))) for x in v_out]
mf = [rg.MeshFace(*fi) for fi in f_out]
[G_mesh.Faces.AddFace(mfi) for mfi in mf] 

G_edge= G_mesh.GetNakedEdges()
# ---------- end grid_mesh ----------
in_l = Number(num)
s_2 = Number(s)
c_2 = Number(c)

# ----
# Deployable auxetics tri (2018)
tri_auxetic = GhPythonScript(in_L=in_l, in_s=s_2, in_c=c_2, G=G, phiList=aux_tri.UC_param)  # -> hLInner, hLInnerF, hLInnerP, bPts; inputs G: tree, phiList: list
# ---------- tri_auxetic: Python ----------
import Rhino.Geometry as rg
import re
from math import sqrt, pi, tan,cos,sin,degrees, atan, atan2
import rhinoscriptsyntax as rs
from collections import Counter

import os
import csv

import ghpythonlib.treehelpers as th
import copy

def norm(a):
    return sqrt(sum([a[i]**2 for i in [0,1,2]]))
     
def vecMult(v,a):
    return [vi*a for vi in v]
    
def ppClosest(h, n):
    '''
    Find the point in h that n is closest to
    '''
    tempD = [rs.Distance(hi,n) for hi in h]
    if min(tempD)>2:
        errorTog = True
    else:
        errorTog = False
    return tempD.index(min(tempD)), errorTog


def mP(p0,p1):
    '''
    Find mid point of two points
    '''
    return rs.AddPoint([(p0[i]+p1[i])/2 for i in [0,1,2]])
    

def iN(j,k,in_c,in_s):
    if in_c!=0 and in_s!=0:
        if k == 0:
            if j == 0:
                return 1
            if j == 1:
                return 0
            if j == 2:
                return 2
        if k == -1:
            if j == 0:
                return 2
            if j == 1:
                return 1
            if j == 2:
                return 0
    else:
        if k == 0:
            if j == 0:
                return 2
            if j == 1:
                return 1
            if j == 2:
                return 0
        if k == -1:
            if j == 0:
                return 0
            if j == 1:
                return 2
            if j == 2:
                return 1

def genTri(i_out,c_out,x_out, phiList, in_L, in_s, in_c):
 
    conLineT = []
    
    # generate a triangle given the phi value. The phi value is determined by the scale factor
    
    for j, (iFlip, c, phi) in enumerate(zip(i_out, c_out, phiList)):
        
        y1 = sin(phi)/sin(pi/3)

        x2 = cos(pi/6-phi)
        y2 = y1+sin(pi/6-phi)

        x3 = sin(phi)
        y3 = y1+cos(phi)

        ptL = []
        ptL.append([0, y1,0])
        ptL.append([x2,y2,0])
        ptL.append([x3,y3,0])
        ptL.append([0, y1,0])
        rsPtL = rs.AddPoints(ptL)

        theta = (atan(ptL[2][0]/ ptL[2][1]))
        
        # rescale the triangle to fit the boundary of the grid trig
        sizing_factor = (sqrt(3)/((tan(theta) + sqrt(3))*cos(theta)))/norm(ptL[2])

        # and also scale by the l_o
        rs.ScaleObjects(rsPtL,[0,0,0],[in_L*sizing_factor]*3)
        
        # move the triangle to center at 0,0,0
        rs.MoveObjects(rsPtL, [-in_L*0.5/tan(pi/3),-in_L*0.5,0])
    
        rsPtL.append(rsPtL[0])
        
        actPL  = rs.AddPolyline(rsPtL)
        if in_s!=0. and in_c!=0.:
            
            # if the 
            cL = [rs.ScaleObject(rs.AddLine([0,0,0],x), [0,0,0], [5]*3) for x in rsPtL]
            
            cV = [rs.VectorUnitize(rs.VectorCreate([0,0,0], x)) for x in rsPtL]

            cV = [rs.VectorRotate(x, -90, [0,0,1]) for x in cV]

            c0=[rs.CopyObject(x,vecMult(y, -in_c)) for x,y in zip(cL,cV)]
            c1=[rs.CopyObject(x,vecMult(y, in_c)) for x,y in zip(cL,cV)]

         
            actPLo = rs.OffsetCurve(actPL, [0,0,0], in_s)
            
            conLine = []
            triLine = []
            triLineT = []
            
            inP  = []
            outP = []
            for i in [0,1,2]:
                outP.append(rs.CurveCurveIntersection(c0[i], regPL )[0][1])
                inP.append(rs.CurveCurveIntersection( c0[i], actPLo)[0][1])
                conLine.append(rs.AddLine(outP[-1],inP[-1]))
                outP.append(rs.CurveCurveIntersection(c1[i], regPL )[0][1])
                inP.append(rs.CurveCurveIntersection( c1[i], actPLo)[0][1])
                conLine.append(rs.AddLine(outP[-1],inP[-1]))

            triLine = [rs.AddLine(inP[i-1],inP[i]) for i in range(0,5,2)]
            
            [rs.RotateObjects(x, [0,0,0],-30) for x in conLine]
            [rs.RotateObjects(x, [0,0,0],-30) for x in triLine]
            
            # move them into their respective center coordinate
            [rs.MoveObject(x,c) for x in conLine]
            [rs.MoveObject(x,c) for x in triLine]
            
            # depending on whether the triangle is upright or not, flip half of them
            if iFlip==1:
                sP = rs.CopyObject(c,[-1,0,0])
                eP = rs.CopyObject(c,[1,0,0])
                
                [rs.MirrorObject(x,eP,sP) for x in conLine]
                [rs.MirrorObject(x,eP,sP) for x in triLine]
            
            triLineT.append(rs.JoinCurves([conLine[5], triLine[0], conLine[0]]))
            triLineT.append(rs.JoinCurves([conLine[1], triLine[1], conLine[2]]))
            triLineT.append(rs.JoinCurves([conLine[3], triLine[2], conLine[4]]))
            
            conLineT.append(triLineT)
        else:
            rs.RotateObjects(actPL, [0,0,0],-30)
            # move them into their respective center coordinate
            rs.MoveObject(actPL,c)
            
            # depending on whether the triangle is upright or not, flip half of them
            if iFlip==1:
                sP = rs.CopyObject(c,[-1,0,0])
                eP = rs.CopyObject(c,[1,0,0])
                rs.MirrorObject(actPL,eP,sP)
            
            conLineT.append(rs.ExplodeCurves(actPL))
        
    conPtT = []
    for x in conLineT:
        conPtT.append([rs.PolylineVertices(y) for y in x])

    # now match up the vertices that neighbouring holes share
    conPtT_mod = copy.deepcopy(conPtT)
    bPts = []
    iInnerT = []

    for i,xi in enumerate(x_out):
        iInner = []
        for j in [0,1,2]:
            for k in [0,-1]:
                temp_0 = conPtT[i][j][k]
                temp_1 = [conPtT[xii][iN(j,k,in_c,in_s)][k] for xii in xi]
                
                # ErrorTog is True if the point distances are too far.
                # This can only happen if they have no neighbouring holes,
                # and this happens only if the holes are at the boundary
                
                idC,errorTog = ppClosest(temp_1, temp_0)
                if errorTog == False:
                    conPtT_mod[i][j][k] = mP(temp_1[idC],temp_0)
                else:
                    bPts.append(conPtT[i][j][k])
            iInner.append([i,j])
        iInnerT.append(iInner)
        
    # Split the hole polygons by whether they are interior polygons or ones that intersect with the boundary

    hLInnerT = []
    
    def dupPt(pt1,pt2):
        if pt1[0]==pt2[0] and pt1[1]==pt2[1] and pt1[2]==pt2[2]:
            return True
        else:
            return False
    for iInner in iInnerT:
        hLInner = []
        for iI in iInner:
            temp = conPtT_mod[iI[0]][iI[1]]
            hLInner.append(rs.AddPolyline(temp))
        hLInnerT.append(rs.JoinCurves(hLInner))
        
    hLInnerT = th.list_to_tree(hLInnerT)
    return [hLInnerT, bPts] 
    
[v_out, f_out, c_out, i_out, x_out] = th.tree_to_list(G)

c_out = rs.AddPoints(c_out)

#x_out = th.tree_to_list(x_out)

# calculating the regular triangle
rTri  = []
rTri.append([-sqrt(3)/2*in_L+sqrt(3)/6*in_L*2, -in_L/2])
rTri.append([-sqrt(3)/2*in_L+sqrt(3)/6*in_L*2, in_L/2])
rTri.append([sqrt(3)/6*in_L*2, 0.])
rTri  = rs.AddPoints(rTri)
rTri.append(rTri[0])
regPL = rs.AddPolyline(rTri)

# generate two sets of triangles, the first is in the closed and flat state
[hLInner, bPts]   = genTri(i_out,c_out,x_out, phiList, in_L, in_s, in_c)
# generate two sets of triangles, the first is in the closed and flat state
[hLInnerF, bPtsF]  = genTri(i_out,c_out,x_out, phiList, in_L, 0., 0.)

# the second, is the opened, and will be lifted into the 3D state
phiFull = [pi/3 for x in phiList]
[hLInnerP, bPtsP]  = genTri(i_out,c_out,x_out, phiFull, in_L, 0., 0.)
# ---------- end tri_auxetic ----------
alongcrv = SortAlongCurve(Points=tri_auxetic.bPts, Curve=grid_mesh.G_edge)  # -> Points, Indices
python_2 = GhPythonScript(V=alongcrv.Points, cg=Slider(0.1, range=0..0.1), in_L=in_l)  # -> SOut; inputs V: list
# ---------- python_2: Python ----------
import rhinoscriptsyntax as rs

PL = rs.AddPolyline(V)
S = rs.ExplodeCurves(PL)
SOut = []
for Si in S:
    if rs.CurveLength(Si)<cg*in_L:
        SOut.append(Si)
# ---------- end python_2 ----------
join = JoinCurves(Curves=flatten([python_2, tri_auxetic.hLInner]), Preserve=False)

# ----
# Cut lines
crv_4 = Curve(join)
